# Grasshopper definition FacadeEmbed_JinQiao_Podium.gh (Grasshopper 1.0.7)
# plug-ins: EleFront, Wombat, Hare, Pufferfish, TT Toolbox

# ---- group: 钢结构预埋
crv = Curve([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])

# ---- group: 板槽
inblock = InsertBlock(BlockName="xxx", SourcePlane=PlaneXY(0, 0, 0))

# ----
# 单体选型
list = ValueList({"板埋": 0, "槽埋": 1, "板槽埋": 2}, selected="槽埋")
list_2 = ValueList({"顶埋": 0, "侧埋": 1}, selected="顶埋")
panel = Panel(list)
panel_2 = Panel(list_2)

# ----
# Find Block and Curve
data = Data(["PX-GLAZ-F2$0$PX-GLAZ-F2$0$fin", "PX-GLAZ-F2$0$PX-GLAZ-F1$0$标准块", "PX-GLAZ-F2$0$PX-GLAZ-F1$0$fin", "PX-GLAZ-F2$0$PX-GLAZ-F2$0$标准块", "PX-GLAZ-F2$0$PX-GLAZ-F3$0$标准块", "PX-GLAZ-F2$0$T3T"])
crv_2 = Curve(<curve referenced from the Rhino model>)
crv_3 = Curve(<curve referenced from the Rhino model>)
listblockd = ListBlockDocument()
panel_3 = Panel(data)
layer = ObjectLayer(Guid=crv_2)  # -> LayerIndex, LayerPathName
disc = Discontinuity(Curve=crv_3, Level=1)  # -> Points, Parameters
panel_4 = Panel(layer.LayerPathName)
panel_5 = Panel(listblockd)
refblock = ReferenceBlockByName(BlockName=panel_3)
deblock = DeconstructBlock(Block=refblock)  # -> Name, Plane, Geometry
reflay = ReferenceByLayer(LayerName=panel_4)
merge = Merge(Data2=reflay)

# ---- group: 结构线
crv_4 = Curve(<curve referenced from the Rhino model>)

# ----
# 平面定位INPUT
crv_5 = Curve([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])

# ---- group: 玻璃线
玻璃线 = Curve(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)
玻璃线_2 = Curve(<curve referenced from the Rhino model>)
玻璃线_3 = Curve(<curve referenced from the Rhino model>)

# ---- group: 定位竖料
crv_6 = Curve([<curve referenced from the Rhino model> x300])
crv_7 = Curve([<curve referenced from the Rhino model> x180])
crv_8 = Curve([<curve referenced from the Rhino model> x383])

# ---- group: 混凝土
# 板埋几何INPUT
list_3 = ValueList({"C15": 0, "C20": 1, "C25": 2, "C30": 3, "C35": 4, "C40": 5}, selected="C35")

# ---- group: 钢筋牌号
list_4 = ValueList({"HPB300": 0, "HRB400": 1}, selected="HPB300")

# ---- group: 直径
list_5 = ValueList({"10": 0, "12": 1, "16": 2, "18": 3, "20": 4, "25": 5}, selected="12")

# ---- group: 列
list_6 = ValueList({"2X": 0, "3X": 1, "4X": 2}, selected="3X")

# ---- group: 行
list_7 = ValueList({"2Y": 0, "3Y": 1, "4Y": 2}, selected="2Y")

# ---- group: 锚筋间距
s_x = Slider(22, range=14..60, expression="X*5")
s_y = Slider(22, range=14..60, expression="X*5")

# ----
crv_9 = Curve([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])
reflay_2 = ReferenceByLayer(LayerName="Arch_curve_angular_withLocation")
reflay_3 = ReferenceByLayer(LayerName="Arch_curve_angular")
reflay_4 = ReferenceByLayer(LayerName="ArchCurve_Whole")
reflay_5 = ReferenceByLayer(LayerName="Arch_curve_doubleLine")
reflay_6 = ReferenceByLayer(LayerName="Arch_curve_smooth")

# ----
# 槽埋-角部选择
list_8 = ValueList({"槽埋角部-L形": 0, "槽埋角部-I形": 1}, selected="槽埋角部-I形")

join = JoinCurves(Curves=crv_9, Preserve=False)
flip = FlipCurve(Curve=玻璃线)  # -> Curve, Flag
boundary = BoundarySurfaces(Edges=join)

crv_10 = Curve(reflay_5)
disc_2 = Discontinuity(Curve=graft(crv_10), Level=1)  # -> Points, Parameters
number_slider = Slider(300, range=0..1000)
crv_cp = CurveClosestPoint(Point=disc_2.Points, Curve=graft(crv_10))  # -> Point, Parameter, Distance
neg = Negative(Value=number_slider)
eval = EvaluateCurve(Curve=graft(crv_10), Parameter=crv_cp.Parameter)  # -> flatten(Point), Tangent, flatten(Angle)
filter = StreamFilter(Gate=Toggle(True), Stream0=number_slider, Stream1=neg)
deg = Degrees(Radians=eval.Angle)
offset = OffsetCurve(Curve=crv_10, Distance=expr("-X", filter), Corners=1)
panel_6 = Panel(deg)
larger = LargerThan(FirstNumber=deg, SecondNumber=Slider(60, range=0..100))  # -> LargerThan, OrEqualTo
disc_3 = Discontinuity(Curve=offset, Level=1)  # -> flatten(Points), Parameters
dispatch = Dispatch(List=eval.Point, DispatchPattern=larger.LargerThan)  # -> ListA, ListB
end = EndPoints(Curve=crv_10)  # -> Start, End
data_2 = Data(dispatch.ListA)
pull = PullPoint(Point=data_2, Geometry=flatten(offset), ClosestOnly=True)  # -> ClosestPoint, Distance
testpoint = TestPoint(archPoint=pull.ClosestPoint, crvPoint=disc_3.Points)  # -> out, specialPt; inputs archPoint: list of Point3d, crvPoint: list of Point3d
# ---------- testpoint: C# ----------
    List<int> passIndex = new List<int>();

    for(int i = 0; i < archPoint.Count; i++){
      foreach(Point3d t in crvPoint){
        if(archPoint[i].X == t.X && archPoint[i].Y == t.Y && archPoint[i].Z == t.Z){
          Print("pass");
          passIndex.Add(i);}
      }
    }

    specialPt = passIndex;
# ---------- end testpoint ----------

filter_2 = StreamFilter(Gate=Toggle(True), Stream0=玻璃线, Stream1=flip.Curve)
sunion = SolidUnion(Breps=boundary)
offset_2 = OffsetCurve(Curve=filter_2, Distance=expr("-x", Slider(375, range=0..1000)), Corners=1)
area = Area(Geometry=sunion)  # -> Area, Centroid
pt = Point(area.Centroid)
explode = Explode(Curve=offset_2, Recursive=True)  # -> Segments, Vertices

# ---- group: 钢结构预埋
# 随文件数据请勿覆盖
crv_11 = Curve([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])

# ---- group: 槽埋3D
brep = Brep(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)

# ----
pt_2 = Point(explode.Vertices)
entwine = Entwine(Branch00=sunion, Branch01=pt, FlattenInputs=True)
max = Maximum(A=s_x, B=s_y)
flip_2 = FlipMatrix(Data=entwine)
filter_3 = StreamFilter(Gate=list_3, Stream0=7.2, Stream1=9.6, Stream2=11.9, Stream3=14.3, Stream4=16.7, Stream5=19.1)
filter_4 = StreamFilter(Gate=list_4, Stream0=270, Stream1=360)
filter_5 = StreamFilter(Gate=list_5, Stream0=10, Stream1=12, Stream2=16, Stream3=18, Stream4=20, Stream5=25)
filter_6 = StreamFilter(Gate=list_3, Stream0=0.91, Stream1=1.1, Stream2=1.27, Stream3=1.43, Stream4=1.57, Stream5=1.71)
filter_7 = StreamFilter(Gate=list_4, Stream0=0.16, Stream1=0.14)
addition = Addition(A=list_6, B=1)
addition_2 = Addition(A=list_7, B=1)
division = Division(A=max, B=8)

# ---- group: 建筑定位轮廓
item = ListItem(List=flip_2, Index="0", Wrap=True)  # -> flatten(Item)

# ---- group: 埋件定位点
item_2 = ListItem(List=flip_2, Index="-1", Wrap=True)  # -> flatten(Item)

# ----
t = Integer(division)
panel_7 = Panel(filter_6)
panel_8 = Panel(filter_3)
panel_9 = Panel(filter_7)
min = Minimum(A=filter_4, B=300)
brep_2 = Brep(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)
panel_10 = Panel(min)
expression = Expression(A=filter_7, fy=filter_4, ft=filter_6, d=filter_5, Expression="(int((0.6*1.1*A*fy/ft*d)/5)+1)*5")

# ----
# 阴角
item_3 = ListItem(List=pull.ClosestPoint, Index=testpoint.specialPt, Wrap=True)

# ----
# SmoothCurve-阴角&阳角
# 阳角
cull_i = CullIndex(List=pull.ClosestPoint, Indices=testpoint.specialPt, Wrap=True)

# ----
# 导入槽埋模型
brep_3 = Brep(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)

# ---- group: 槽埋
# 槽埋Modeling
brep_4 = Brep(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)
bbox = BoundingBox(Content=brep_3, Plane=PlaneXY(0, 0, 0))  # -> Box, Box_2
debox = DeconstructBox(Box=bbox.Box)  # -> Plane, X, Y, Z
area_2 = Area(Geometry=brep_3)  # -> Area, Centroid
pdecon = Deconstruct(Point=area_2.Centroid)  # -> XComponent, YComponent, ZComponent
dedomain = DeconstructDomain(Domain=debox.Z)  # -> Start, End
xy = XYPlane(Origin=Point(0, 0, 0))
pt_3 = ConstructPoint(XCoordinate=pdecon.XComponent, YCoordinate=pdecon.YComponent, ZCoordinate=dedomain.End)
pl_origin = PlaneOrigin(Base=xy, Origin=pt_3)
xy_2 = XYPlane(Origin=Point(0, 0, 0))
orient = Orient(Geometry=brep_3, Source=pl_origin, Target=xy_2)  # -> Geometry, Transform

# ----
edges = BrepEdges(Brep=bbox.Box)  # -> Naked, Interior, NonManifold
item_4 = ListItem(List=edges.Interior, Index="5", Wrap=True)
item_5 = ListItem(List=edges.Interior, Index="4", Wrap=True)
clx = CurveLine(Curve=item_5, Line=item_4)  # -> Points, Params, Count
Y = UnitY(Factor=item_4)
rotate = Rotate(Geometry=brep_3, Angle=1.570796327, Plane=clx.Points)  # -> Geometry, Transform
move = Move(Geometry=rotate.Geometry, Motion=Y)  # -> Geometry, Transform
merge_2 = Merge(Data1=brep_3, Data2=move.Geometry)  # -> flatten(Result)
sunion_2 = SolidUnion(Breps=merge_2)
bbox_2 = BoundingBox(Content=sunion_2, Plane=PlaneXY(0, 0, 0))  # -> Box, Box_2
area_3 = Area(Geometry=sunion_2)  # -> Area, Centroid
debox_2 = DeconstructBox(Box=bbox_2.Box)  # -> Plane, X, Y, Z
pdecon_2 = Deconstruct(Point=area_3.Centroid)  # -> XComponent, YComponent, ZComponent
dedomain_2 = DeconstructDomain(Domain=debox_2.Z)  # -> Start, End
pt_4 = ConstructPoint(XCoordinate=pdecon_2.XComponent, YCoordinate=pdecon_2.YComponent, ZCoordinate=dedomain_2.End)
xy_3 = XYPlane(Origin=Point(0, 0, 0))
pl_origin_2 = PlaneOrigin(Base=xy_3, Origin=pt_4)
xy_4 = XYPlane(Origin=Point(0, 0, 0))
orient_2 = Orient(Geometry=sunion_2, Source=pl_origin_2, Target=xy_4)  # -> Geometry, Transform

# ----
# 导入槽埋模型
brep_5 = Brep(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)

filter_8 = StreamFilter(Gate=list_8, Stream0=orient_2.Geometry, Stream1=orient.Geometry)
pln = Plane(flatten(deblock.Plane))
entwine_2 = Entwine(Branch00=orient.Geometry, Branch01=filter_8, FlattenInputs=True)
deplane = DeconstructPlane(Plane=pln)  # -> Origin, XAxis, YAxis, ZAxis
cullduppoints = RemoveDuplicatePoints(InputPoints=deplane.Origin, Tolerance=0.001)  # -> OutputPoints, FirstPointIndexes
null = NullItem(Item=cullduppoints.FirstPointIndexes)  # -> NullFlags, InvalidFlags, Description
dispatch_2 = Dispatch(List=pln, DispatchPattern=null.InvalidFlags)  # -> ListA, ListB
pln_2 = Plane(dispatch_2.ListA)
deplane_2 = DeconstructPlane(Plane=pln_2)  # -> Origin, XAxis, YAxis, ZAxis
crv_12 = Curve(offset_2)
crv_13 = Curve([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])
crv_14 = Curve(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)
merge_3 = Merge(Data1=crv_13, Data2=crv_14)

# ----
# 求曲线转折点
clscrv = CloseCurve(Curve=reflay_4, CloseType=0, Bulge=0.5, Tolerance=0)  # -> Closed, R
crv_15 = Curve(reflay_6)
disc_4 = Discontinuity(Curve=graft(crv_15), Level=1)  # -> Points, Parameters
crv_cp_2 = CurveClosestPoint(Point=disc_4.Points, Curve=graft(crv_15))  # -> Point, Parameter, Distance
eval_2 = EvaluateCurve(Curve=graft(crv_15), Parameter=crv_cp_2.Parameter)  # -> flatten(Point), Tangent, flatten(Angle)
deg_2 = Degrees(Radians=eval_2.Angle)
offset_3 = OffsetCurve(Curve=clscrv.Closed, Distance=expr("-X", Slider(300, range=0..1000)), Corners=1)
panel_11 = Panel(deg_2)
larger_2 = LargerThan(FirstNumber=deg_2, SecondNumber=Slider(60, range=0..100))  # -> LargerThan, OrEqualTo
disc_5 = Discontinuity(Curve=offset_3, Level=1)  # -> flatten(Points), Parameters
dispatch_3 = Dispatch(List=eval_2.Point, DispatchPattern=larger_2.LargerThan)  # -> ListA, ListB

# ----
# 转角点
data_3 = Data(dispatch_3.ListA)

pull_2 = PullPoint(Point=data_3, Geometry=flatten(offset_3), ClosestOnly=True)  # -> ClosestPoint, Distance
testpoint_2 = TestPoint(archPoint=pull_2.ClosestPoint, crvPoint=disc_5.Points)  # -> out, specialPt; inputs archPoint: list of Point3d, crvPoint: list of Point3d; same code as testpoint

pull_3 = PullPoint(Point=flatten(deblock.Plane), Geometry=crv_15, ClosestOnly=True)  # -> ClosestPoint, Distance
pull_4 = PullPoint(Point=pull_3.ClosestPoint, Geometry=data_3, ClosestOnly=True)  # -> ClosestPoint, Distance
flatten = FlattenTree(Tree=refblock, Path="{0}")
sort = SortList(Keys=pull_4.Distance, ValuesA=flatten)  # -> Keys, ValuesA
panel_12 = Panel(sort.Keys)
smaller = SmallerThan(FirstNumber=sort.Keys, SecondNumber=Slider(100, range=0..100))  # -> SmallerThan, OrEqualTo
dispatch_4 = Dispatch(List=sort.ValuesA, DispatchPattern=smaller.SmallerThan)  # -> ListA, ListB
data_4 = Data(dispatch_4.ListA)
deblock_2 = DeconstructBlock(Block=data_4)  # -> Name, Plane, Geometry
deplane_3 = DeconstructPlane(Plane=deblock_2.Plane)  # -> Origin, XAxis, YAxis, ZAxis
pt_5 = Point(data_3)
pull_5 = PullPoint(Point=deplane_3.Origin, Geometry=pt_5, ClosestOnly=True)  # -> ClosestPoint, Distance
cir = Circle(Plane=pull_5.ClosestPoint, Radius=Slider(300, range=0..1000))
crv_16 = Curve(crv_15)
amp = Amplitude(Vector=deplane_3.YAxis, Amplitude=Slider(200, range=0..1000))
ccx = CurveCurve(CurveA=cir, CurveB=crv_16)  # -> Points, ParamsA, ParamsB
move_2 = Move(Geometry=pull_5.ClosestPoint, Motion=amp)  # -> Geometry, Transform
item_6 = ListItem(List=ccx.Points, Index=0, Wrap=True)
clean = CleanTree(RemoveNulls=True, RemoveInvalid=True, RemoveEmpty=Toggle(True), Tree=item_6)
ln = Line(StartPoint=pull_5.ClosestPoint, EndPoint=clean)
ln_2 = Line(StartPoint=pull_5.ClosestPoint, EndPoint=move_2.Geometry)
angle = Angle(VectorA=ln_2, VectorB=ln)  # -> Angle, Reflex
deg_3 = Degrees(Radians=angle.Angle)
flatten_2 = FlattenTree(Tree=deg_3, Path="{0}")
panel_13 = Panel(flatten_2)
c_script = CSharpScript(angle=flatten_2, minus=Slider(80, range=0..100))  # -> out, results; inputs angle: list of Double, minus: Double
# ---------- c_script: C# ----------
    foreach (double ang in angle){
      if (ang > minus){
        angleEach = ang - 90;
        Print("!!!!!!!!");
        MyAngle.Add(angleEach);
      }
      else{
        angleEach = ang;
        Print("00000");
        MyAngle.Add(angleEach);
      }
      
    }

    results = MyAngle;
# ---------- c_script: C# additional code ----------
  List<double> MyAngle = new List<double>();
  double angleEach = 0;
# ---------- end c_script ----------
larger_3 = LargerThan(FirstNumber=c_script.results, SecondNumber=Slider(30, range=0..100))  # -> LargerThan, OrEqualTo
panel_14 = Panel(c_script.results)
dispatch_5 = Dispatch(List=flatten(data_4), DispatchPattern=flatten(larger_3.LargerThan))  # -> ListA, ListB
data_5 = Data(dispatch_5.ListA)

# ----
# SmoothCurve-阴角&阳角
# 阳角
item_7 = ListItem(List=data_3, Index=testpoint_2.specialPt, Wrap=True)

# ----
# 阴角
cull_i_2 = CullIndex(List=data_3, Indices=testpoint_2.specialPt, Wrap=True)

# ----
# remove duplicate block and reconstruct plane
deblock_3 = DeconstructBlock(Block=data_5)  # -> Name, Plane, Geometry
deplane_4 = DeconstructPlane(Plane=flatten(deblock_3.Plane))  # -> Origin, XAxis, YAxis, ZAxis
cullduppoints_2 = RemoveDuplicatePoints(InputPoints=deplane_4.Origin, Tolerance=0.001)  # -> OutputPoints, FirstPointIndexes
null_2 = NullItem(Item=cullduppoints_2.FirstPointIndexes)  # -> NullFlags, InvalidFlags, Description
dispatch_6 = Dispatch(List=flatten(deblock_3.Plane), DispatchPattern=null_2.InvalidFlags)  # -> ListA, ListB
pln_3 = Plane(dispatch_6.ListA)
deplane_5 = DeconstructPlane(Plane=pln_3)  # -> Origin, XAxis, YAxis, ZAxis

testpoint_3 = TestPoint(archPoint=deplane_2.Origin, crvPoint=deplane_5.Origin)  # -> out, specialPt; inputs archPoint: list of Point3d, crvPoint: list of Point3d; same code as testpoint
cull_i_3 = CullIndex(List=pln_2, Indices=testpoint_3.specialPt, Wrap=True)

# ---- group: 阴阳角区分
cp = ClosestPoint(Point=pt_2, Cloud=item_2)  # -> ClosestPoint, CPIndex, Distance
item_8 = ListItem(List=item_2, Index=cp.CPIndex, Wrap=True)
crv_cp_3 = CurveClosestPoint(Point=item_8, Curve=offset_2)  # -> Point, Parameter, Distance
eval_3 = EvaluateCurve(Curve=offset_2, Parameter=crv_cp_3.Parameter)  # -> Point, Tangent, Angle

# ----
# 板槽埋Modeling
multiplication = Multiplication(A=s_x, B=addition)
multiplication_2 = Multiplication(A=s_y, B=addition_2)
recgrid = Rectangular(Plane=PlaneXY(0, 0, 0), SizeX=s_x, SizeY=s_y, ExtentX=addition, ExtentY=addition_2)  # -> Cells, Points
直径 = Text(filter_5)
division_2 = Division(A=multiplication, B=2)
division_3 = Division(A=multiplication_2, B=2)
vec = VectorXYZ(XComponent=expr("-x", division_2), YComponent=expr("-x", division_3), ZComponent=0)  # -> Vector, Length
move_3 = Move(Geometry=recgrid.Points, Motion=vec.Vector)  # -> Geometry, Transform
division_4 = Division(A=直径, B=2)
cyl = Cylinder(Base=move_3.Geometry, Radius=division_4, Length=expr("-x", expression))
X = UnitX(Factor=直径)
multiplication_3 = Multiplication(A=直径, B=6)
edges_2 = BrepEdges(Brep=cyl)  # -> Naked, Interior, NonManifold
item_9 = ListItem(List=edges_2.Naked, Index=0, Wrap=True)
max_2 = Maximum(A=multiplication_3, B=70)
move_4 = Move(Geometry=item_9, Motion=X)  # -> Geometry, Transform
multiplication_4 = Multiplication(A=max_2, B=2)
addition_3 = Addition(A=multiplication, B=multiplication_4)
addition_4 = Addition(A=multiplication_2, B=multiplication_4)
division_5 = Division(A=t, B=2)
expression_2 = Expression(x=addition_4, Expression="Ceiling(x/10)*10/2")
expression_3 = Expression(x=addition_3, Expression="Ceiling(x/10)*10/2")
round = Round(Number=division_5)  # -> Nearest, Floor, Ceiling
multiplication_5 = Multiplication(A=round.Ceiling, B=2)
dom = ConstructDomain(DomainStart=expr("-x", expression_2), DomainEnd=expression_2)
dom_2 = ConstructDomain(DomainStart=expr("-x", expression_3), DomainEnd=expression_3)
box = DomainBox(Base=PlaneXY(0, 0, 0), X=dom_2, Y=dom, Z=multiplication_5)
Z = UnitZ(Factor=expr("-x", multiplication_5))

multiplication_6 = Multiplication(A=直径, B=5)

Z_2 = UnitZ(Factor=multiplication_6)
extr = Extrude(Base=move_4.Geometry, Direction=Z_2)
cap = CapHoles(Brep=[extr, cyl])
merge_4 = Merge(Data1=cap, Data2=box)
flatten_3 = FlattenTree(Tree=merge_4, Path="{0}")
move_5 = Move(Geometry=flatten_3, Motion=Z)  # -> Geometry, Transform

brep_6 = Brep(move_5.Geometry)

# ----
# 槽埋+板埋合并
bbox_3 = BoundingBox(Content=brep_5, Plane=PlaneXY(0, 0, 0))  # -> Box, Box_2
debox_3 = DeconstructBox(Box=bbox_3.Box)  # -> Plane, X, Y, Z
area_4 = Area(Geometry=brep_5)  # -> Area, Centroid
dedomain_3 = DeconstructDomain(Domain=debox_3.Z)  # -> Start, End
pdecon_3 = Deconstruct(Point=area_4.Centroid)  # -> XComponent, YComponent, ZComponent
xy_5 = XYPlane(Origin=Point(0, 0, 0))
pt_6 = ConstructPoint(XCoordinate=pdecon_3.XComponent, YCoordinate=pdecon_3.YComponent, ZCoordinate=dedomain_3.End)
pl_origin_3 = PlaneOrigin(Base=xy_5, Origin=pt_6)
xy_6 = XYPlane(Origin=Point(0, 0, 0))
orient_3 = Orient(Geometry=brep_5, Source=pl_origin_3, Target=xy_6)  # -> Geometry, Transform
bbox_4 = BoundingBox(Content=orient_3.Geometry, Plane=PlaneXY(0, 0, 0))  # -> Box, Box_2
sdiff = SolidDifference(BrepsA=move_5.Geometry, BrepsB=bbox_4.Box)
sunion_3 = SolidUnion(Breps=[sdiff, orient_3.Geometry])  # -> flatten(Result)

edges_3 = BrepEdges(Brep=bbox_3.Box)  # -> Naked, Interior, NonManifold
item_10 = ListItem(List=edges_3.Interior, Index="5", Wrap=True)
item_11 = ListItem(List=edges_3.Interior, Index="4", Wrap=True)
clx_2 = CurveLine(Curve=item_11, Line=item_10)  # -> Points, Params, Count
Y_2 = UnitY(Factor=item_10)
rotate_2 = Rotate(Geometry=brep_5, Angle=1.570796327, Plane=clx_2.Points)  # -> Geometry, Transform
move_6 = Move(Geometry=rotate_2.Geometry, Motion=Y_2)  # -> Geometry, Transform
merge_5 = Merge(Data1=brep_5, Data2=move_6.Geometry)  # -> flatten(Result)
sunion_4 = SolidUnion(Breps=merge_5)
bbox_5 = BoundingBox(Content=sunion_4, Plane=PlaneXY(0, 0, 0))  # -> Box, Box_2
area_5 = Area(Geometry=sunion_4)  # -> Area, Centroid
debox_4 = DeconstructBox(Box=bbox_5.Box)  # -> Plane, X, Y, Z
pdecon_4 = Deconstruct(Point=area_5.Centroid)  # -> XComponent, YComponent, ZComponent
dedomain_4 = DeconstructDomain(Domain=debox_4.Z)  # -> Start, End
pt_7 = ConstructPoint(XCoordinate=pdecon_4.XComponent, YCoordinate=pdecon_4.YComponent, ZCoordinate=dedomain_4.End)
xy_7 = XYPlane(Origin=Point(0, 0, 0))
pl_origin_4 = PlaneOrigin(Base=xy_7, Origin=pt_7)
xy_8 = XYPlane(Origin=Point(0, 0, 0))
orient_4 = Orient(Geometry=sunion_4, Source=pl_origin_4, Target=xy_8)  # -> Geometry, Transform

entwine_3 = Entwine(Branch00=sunion_3, Branch01=orient_4.Geometry, FlattenInputs=True)

# ----
# 板埋Modeling
multiplication_7 = Multiplication(A=s_x, B=addition)
multiplication_8 = Multiplication(A=s_y, B=addition_2)
recgrid_2 = Rectangular(Plane=PlaneXY(0, 0, 0), SizeX=s_x, SizeY=s_y, ExtentX=addition, ExtentY=addition_2)  # -> Cells, Points
直径_2 = Text(filter_5)
division_6 = Division(A=multiplication_7, B=2)
division_7 = Division(A=multiplication_8, B=2)
vec_2 = VectorXYZ(XComponent=expr("-x", division_6), YComponent=expr("-x", division_7), ZComponent=0)  # -> Vector, Length
move_7 = Move(Geometry=recgrid_2.Points, Motion=vec_2.Vector)  # -> Geometry, Transform
division_8 = Division(A=直径_2, B=2)
cyl_2 = Cylinder(Base=move_7.Geometry, Radius=division_8, Length=expr("-x", expression))
X_2 = UnitX(Factor=直径_2)
multiplication_9 = Multiplication(A=直径_2, B=6)
edges_4 = BrepEdges(Brep=cyl_2)  # -> Naked, Interior, NonManifold
item_12 = ListItem(List=edges_4.Naked, Index=0, Wrap=True)
max_3 = Maximum(A=multiplication_9, B=70)
move_8 = Move(Geometry=item_12, Motion=X_2)  # -> Geometry, Transform
multiplication_10 = Multiplication(A=max_3, B=2)
addition_5 = Addition(A=multiplication_7, B=multiplication_10)
addition_6 = Addition(A=multiplication_8, B=multiplication_10)
division_9 = Division(A=t, B=2)
expression_4 = Expression(x=addition_6, Expression="Ceiling(x/10)*10/2")
expression_5 = Expression(x=addition_5, Expression="Ceiling(x/10)*10/2")
round_2 = Round(Number=division_9)  # -> Nearest, Floor, Ceiling
multiplication_11 = Multiplication(A=round_2.Ceiling, B=2)
dom_3 = ConstructDomain(DomainStart=expr("-x", expression_4), DomainEnd=expression_4)
dom_4 = ConstructDomain(DomainStart=expr("-x", expression_5), DomainEnd=expression_5)
box_2 = DomainBox(Base=PlaneXY(0, 0, 0), X=dom_4, Y=dom_3, Z=multiplication_11)
Z_3 = UnitZ(Factor=expr("-x", multiplication_11))
move_9 = Move(Geometry=box_2, Motion=Z_3)  # -> Geometry, Transform
Z_4 = UnitZ(Factor=expr("-x", multiplication_11))

multiplication_12 = Multiplication(A=直径_2, B=5)

Z_5 = UnitZ(Factor=multiplication_12)
extr_2 = Extrude(Base=move_8.Geometry, Direction=Z_5)
cap_2 = CapHoles(Brep=[extr_2, cyl_2])
merge_6 = Merge(Data1=cap_2, Data2=box_2)
flatten_4 = FlattenTree(Tree=merge_6, Path="{0}")
move_10 = Move(Geometry=flatten_4, Motion=Z_4)  # -> Geometry, Transform

box_3 = DomainBox(Base=PlaneXY(0, 0, 0), X=dom_4, Y=dom_4, Z=multiplication_11)
merge_7 = Merge(Data1=cap_2, Data2=box_3)
flatten_5 = FlattenTree(Tree=merge_7, Path="{0}")
move_11 = Move(Geometry=flatten_5, Motion=Z_4)  # -> Geometry, Transform
entwine_4 = Entwine(Branch00=move_10.Geometry, Branch01=move_11.Geometry, FlattenInputs=True)

# ---- group: 选单体
板埋or槽埋or板槽埋 = StreamFilter(Gate=list, Stream0=entwine_4, Stream1=entwine_2, Stream2=entwine_3)

# ----
# 三视图
# hidden lines of top+pers view
# move to center
# 如果无法完整的生成埋件的三视图，
# 建议选择埋件的3D在Rhino中将
# Top/Perspective/Front/Right 试图缩放至合适大小后重新运行
panel_15 = Panel("""Top
Perspective
Front
Right""")
m2d_rhino = Make2DRhinoView(Name=panel_15, Clip=True)
make2d = Make2D(Geometry=板埋or槽埋or板槽埋, View=m2d_rhino, TangentEdges=False, TangentSeams=False, AutoComputeMake2D=False)  # -> VisibleCurves, VisibleIndex, VisibleType, HiddenCurves, HiddenIndex, HiddenType
bang = ExplodeTree(Data=make2d.VisibleCurves)  # -> Branch0, Branch1, Branch2, Branch3, Branch4, Branch5, Branch6, Branch7
bang_2 = ExplodeTree(Data=make2d.VisibleCurves)  # -> Branch0, Branch1, Branch2, Branch3, Branch4, Branch5, Branch6, Branch7
divdist = DivideDistance(Curve=make2d.HiddenCurves, Distance=Slider(1, range=0..10))  # -> Points, Tangents, Parameters
graft = GraftTree(Tree=make2d.HiddenCurves, IncludeEmptyLists=True, IncludeNullItems=True)
shatter = Shatter(Curve=graft, Parameters=divdist.Parameters)
dispatch_7 = Dispatch(List=shatter, DispatchPattern=[True, False])  # -> ListA, ListB
crv_17 = Curve(dispatch_7.ListA)
pshift = ShiftPaths(Data=crv_17, Offset=-1)
pshift_2 = ShiftPaths(Data=pshift, Offset=-1)
bang_3 = ExplodeTree(Data=pshift_2)  # -> Branch0, Branch1, Branch2, Branch3, Branch4, Branch5, Branch6, Branch7
bang_4 = ExplodeTree(Data=pshift_2)  # -> Branch0, Branch1, Branch2, Branch3, Branch4, Branch5, Branch6, Branch7
entwine_5 = Entwine(Branch00=bang_4.Branch4, Branch01=bang_2.Branch4, FlattenInputs=True)  # -> flatten(Result)
entwine_6 = Entwine(Branch00=bang_4.Branch5, Branch01=bang_2.Branch5, FlattenInputs=True)  # -> flatten(Result)
entwine_7 = Entwine(Branch00=bang_3.Branch0, Branch01=bang.Branch0, FlattenInputs=True)  # -> flatten(Result)
entwine_8 = Entwine(Branch00=bang_3.Branch1, Branch01=bang.Branch1, FlattenInputs=True)  # -> flatten(Result)
entwine_9 = Entwine(Branch00=entwine_7, Branch01=entwine_8, Branch02=bang.Branch2, Branch03=bang.Branch3, FlattenInputs=True)
entwine_10 = Entwine(Branch00=entwine_5, Branch01=entwine_6, Branch02=bang_2.Branch6, Branch03=bang_2.Branch7, FlattenInputs=True)
group = Group(Objects=entwine_9)
group_2 = Group(Objects=entwine_10)
entwine_11 = Entwine(Branch00=group, Branch01=group_2, FlattenInputs=True)
pshift_3 = ShiftPaths(Data=entwine_11, Offset=-1)
pshift_4 = ShiftPaths(Data=entwine_11, Offset=-1)
number_slider_2 = Slider(2, range=0..10)
# Rhino 文件中导入的块名
boxprop = BoxProperties(Box=pshift_3)  # -> Center, Diagonal, Area, Volume, Degeneracy
pt_8 = Point(Point(957.9296072, 367.7685097, 0))
pt_9 = Point("0,0,0")
recgrid_3 = Rectangular(
    Plane=pt_8,
    SizeX=Slider(12, range=1..20, expression="X*50"),
    SizeY=Slider(10, range=1..20, expression="X*50"),
    ExtentX=number_slider_2,
    ExtentY=number_slider_2)  # -> Cells, Points
vec2pt = Vector2Pt(PointA=boxprop.Center, PointB=pt_9, Unitize=False)  # -> Vector, Length
flatten_6 = FlattenTree(Tree=recgrid_3.Points, Path="{0}")
move_12 = Move(Geometry=pshift_4, Motion=vec2pt.Vector)  # -> flatten(Geometry), Transform
orient_5 = Orient(Geometry=flatten(move_12.Geometry), Source=PlaneXY(0, 0, 0), Target=flatten_6)  # -> Geometry, Transform
cull_i_4 = CullIndex(List=orient_5.Geometry, Indices="-1", Wrap=True)
split = SplitList(List=cull_i_4, Index="4")  # -> ListA, ListB
data_6 = Data(split.ListA)
data_7 = Data(split.ListB)
entwine_12 = Entwine(Branch00=data_6, Branch01=data_7, FlattenInputs=True)
geo = Geometry(entwine_12)

# ---- group: 单体定Top/Side
item_13 = ListItem(List=geo, Index=2, Wrap=True)
item_14 = ListItem(List=geo, Index=Slider(0, range=0..10), Wrap=True)
cluster = Cluster(G=item_14)
cluster_2 = Cluster(G=item_13)

# ---- group: 单体定Top/Side / Top/Side
filter_9 = StreamFilter(Gate=list_2, Stream0=cluster, Stream1=cluster_2)

# ---- group: 单体定Top/Side / Monomer + Top/Side
filter_10 = StreamFilter(Gate=list, Stream0=filter_9, Stream1=filter_9, Stream2=filter_9)  # -> flatten(Stream)

# ---- group: Block
# 自定义块所在图层
# 自定义块所在图层颜色
# 自定义块名称
panel_16 = Panel("Embeded::Embeded")
layer_2 = DefineLayer(Name=panel_16, Color=ColourSwatch(SwatchColor=RGB(255, 0, 0)))
attributes = DefineObjectAttributes(Layer=layer_2)
block = DefineBlock(Geometry=filter_9, Attributes=attributes, BlockName="Steel Plate", BasePlane=PlaneXY(0, 0, 0))

# ---- group: 正常+阳角+阴角区分
cull_i_5 = CullIndex(List=item_2, Indices=cp.CPIndex, Wrap=True)
crv_18 = Curve(offset_2)
crv_19 = Curve(flip.Curve)
explode_2 = Explode(Curve=crv_18, Recursive=True)  # -> Segments, Vertices
explode_3 = Explode(Curve=crv_19, Recursive=True)  # -> Segments, Vertices

# ---- group: 阴角定位-细化
item_15 = ListItem(List=item, Index=cp.CPIndex, Wrap=True)

# ---- group: 大面
# 大面埋件布置
number_slider_3 = Slider(0.002, range=0..0.01)
filter_11 = StreamFilter(Gate=list_2, Stream0=expression_4, Stream1=number_slider_3)
filter_12 = StreamFilter(Gate=list, Stream0=filter_11, Stream1=expression_4, Stream2=filter_11)
offset_4 = OffsetCurve(Curve=offset_2, Distance=expr("-x", filter_12), Plane=PlaneXY(0, 0, 0), Corners=1)

# ---- group: 阴阳角区分 (continued)
crv_cp_4 = CurveClosestPoint(Point=item_8, Curve=offset_4)  # -> Point, Parameter, Distance
vec2pt_2 = Vector2Pt(PointA=crv_cp_4.Point, PointB=crv_cp_3.Point, Unitize=False)  # -> expr("-x", Vector), Length
angle_2 = Angle(VectorA=eval_3.Tangent, VectorB=vec2pt_2.Vector)  # -> Angle, Reflex
deg_4 = Degrees(Radians=angle_2.Angle)
smaller_2 = SmallerThan(FirstNumber=deg_4, SecondNumber=89)  # -> SmallerThan, OrEqualTo
dispatch_8 = Dispatch(List=item_8, DispatchPattern=smaller_2.SmallerThan)  # -> ListA, ListB

# ---- group: 正常+阳角+阴角区分 (continued)
data_8 = Data(dispatch_8.ListA)
data_9 = Data(dispatch_8.ListB)
pull_6 = PullPoint(Point=data_8, Geometry=crv_18, ClosestOnly=True)  # -> ClosestPoint, Distance
pull_7 = PullPoint(Point=data_9, Geometry=crv_19, ClosestOnly=True)  # -> ClosestPoint, Distance
c_script_2 = CSharpScript(archPoint=pull_6.ClosestPoint, crvPoint=explode_2.Vertices)  # -> out, specialPt; inputs archPoint: list of Point3d, crvPoint: list of Point3d; same code as testpoint
c_script_3 = CSharpScript(archPoint=pull_7.ClosestPoint, crvPoint=explode_3.Vertices)  # -> out, specialPt; inputs archPoint: list of Point3d, crvPoint: list of Point3d; same code as testpoint
cull_i_6 = CullIndex(List=data_8, Indices=c_script_2.specialPt, Wrap=True)

# ---- group: 阴角定位-细化 (continued)
dispatch_9 = Dispatch(List=item_15, DispatchPattern=smaller_2.SmallerThan)  # -> ListA, ListB
item_16 = ListItem(List=dispatch_9.ListB, Index=c_script_3.specialPt, Wrap=True)
join_2 = JoinCurves(Curves=item_16, Preserve=False)
explode_4 = Explode(Curve=join_2, Recursive=True)  # -> Segments, Vertices
crv_20 = Curve(simplify(explode_4.Segments))
len = Length(Curve=crv_20)
sort_2 = SortList(Keys=len, ValuesA=crv_20)  # -> Keys, ValuesA
item_17 = ListItem(List=sort_2.ValuesA, Index=0, Wrap=True)  # -> Item2, Item1, Item
crv_21 = Curve([item_17.Item2, item_17.Item1])
disc_6 = Discontinuity(Curve=crv_21, Level=1)  # -> Points, Parameters
item_18 = ListItem(List=disc_6.Points, Index=0, Wrap=True)
pull_8 = PullPoint(Point=disc_6.Points, Geometry=pt_2, ClosestOnly=True)  # -> ClosestPoint, Distance
crv_cp_5 = CurveClosestPoint(Point=disc_6.Points, Curve=offset_2)  # -> Point, Parameter, Distance
sort_3 = SortList(Keys=pull_8.Distance, ValuesA=crv_cp_5.Point)  # -> Keys, ValuesA

# ---- group: 正常+阳角+阴角区分 / 正常-遗漏
cull_i_7 = CullIndex(List=data_9, Indices=c_script_3.specialPt, Wrap=True)

# ---- group: 正常+阳角+阴角区分 / 阴角定位点
item_19 = ListItem(List=data_9, Index=c_script_3.specialPt, Wrap=True)

# ---- group: 正常+阳角+阴角区分 / 正常定位点
merge_8 = Merge(Data1=cull_i_5, Data2=cull_i_7, Data3=cull_i_6)

# ---- group: 正常+阳角+阴角区分 / 阳角定位点
item_20 = ListItem(List=data_8, Index=c_script_2.specialPt, Wrap=True)

# ---- group: 阴角定位-细化 / 阴角-2点定位
item_21 = ListItem(List=sort_3.ValuesA, Index=0, Wrap=True)

# ----
# 阳角埋件布置
pt_10 = Point(item_20)
explode_5 = Explode(Curve=crv_12, Recursive=True)  # -> Segments, Vertices
cp_2 = ClosestPoint(Point=pt_10, Cloud=explode_5.Vertices)  # -> ClosestPoint, CPIndex, Distance
cir_2 = Circle(Plane=cp_2.ClosestPoint, Radius=Slider(150, range=0..1000))
pt_11 = Point(cp_2.ClosestPoint)
ccx_2 = CurveCurve(CurveA=cir_2, CurveB=offset_2)  # -> Points, ParamsA, ParamsB
item_22 = ListItem(List=ccx_2.Points, Index=0, Wrap=True)  # -> Item, Item1
ln_3 = Line(StartPoint=graft(pt_11), EndPoint=graft(item_22.Item))  # -> flatten(Line)
ln_4 = Line(StartPoint=graft(pt_11), EndPoint=graft(item_22.Item1))  # -> flatten(Line)
item_23 = ListItem(List=filter_10, Index="1", Wrap=True)
pl = ConstructPlane(Origin=pt_11, XAxis=ln_3, YAxis=ln_4)
bbox_6 = BoundingBox(Content=graft(item_23), Plane=PlaneXY(0, 0, 0))  # -> Box, Box_2
srf = Surface(bbox_6.Box)
explode_6 = Explode(Curve=srf, Recursive=True)  # -> Segments, Vertices
item_24 = ListItem(List=explode_6.Vertices, Index=0, Wrap=True)  # -> Item, Item1, Item2
ln_5 = Line(StartPoint=graft(item_24.Item1), EndPoint=graft(item_24.Item2))
ln_6 = Line(StartPoint=graft(item_24.Item1), EndPoint=graft(item_24.Item))
ln_7 = Line(StartPoint=graft(item_24.Item1), EndPoint=graft(item_24.Item))
ln_8 = Line(StartPoint=graft(item_24.Item1), EndPoint=graft(item_24.Item2))
pl_2 = ConstructPlane(Origin=item_24.Item1, XAxis=ln_8, YAxis=ln_7)
pl_3 = ConstructPlane(Origin=item_24.Item1, XAxis=ln_6, YAxis=ln_5)
orient_6 = Orient(Geometry=item_23, Source=pl_3, Target=pl)  # -> Geometry, Transform
orient_7 = Orient(Geometry=item_23, Source=pl_2, Target=pl)  # -> Geometry, Transform
merge_9 = Merge(Data1=orient_6.Geometry, Data2=orient_7.Geometry)
filter_13 = StreamFilter(Gate=list_2, Stream0=orient_6.Geometry, Stream1=merge_9)
bbox_7 = BoundingBox(Content=filter_13, Plane=PlaneXY(0, 0, 0))  # -> Box, Box_2
entwine_13 = Entwine(Branch00=filter_13, Branch01=bbox_7.Box, FlattenInputs=True)
flip_3 = FlipMatrix(Data=entwine_13)
item_25 = ListItem(List=flip_3, Index=-1, Wrap=True)  # -> flatten(Item)
item_26 = ListItem(List=flip_3, Index="0", Wrap=True)  # -> flatten(Item)

# ---- group: 阴角
# 阴角埋件布置
explode_7 = Explode(Curve=crv_12, Recursive=True)  # -> Segments, Vertices
cp_3 = ClosestPoint(Point=item_19, Cloud=explode_7.Vertices)  # -> ClosestPoint, CPIndex, Distance
pshift_5 = ShiftPaths(Data=item_21, Offset=-1)
crv_cp_6 = CurveClosestPoint(Point=pshift_5, Curve=offset_4)  # -> Point, Parameter, Distance
crv_cp_7 = CurveClosestPoint(Point=pshift_5, Curve=offset_2)  # -> Point, Parameter, Distance
vec2pt_3 = Vector2Pt(PointA=crv_cp_6.Point, PointB=crv_cp_7.Point, Unitize=False)  # -> expr("-x", Vector), Length
eval_4 = EvaluateCurve(Curve=offset_2, Parameter=crv_cp_7.Parameter)  # -> Point, Tangent, Angle
pl_4 = ConstructPlane(Origin=crv_cp_7.Point, XAxis=eval_4.Tangent, YAxis=vec2pt_3.Vector)
orient_8 = Orient(Geometry=block, Source=PlaneXY(0, 0, 0), Target=pl_4)  # -> Geometry, Transform

# ---- group: 大面 (continued)
crv_cp_8 = CurveClosestPoint(Point=merge_8, Curve=offset_4)  # -> Point, Parameter, Distance
crv_cp_9 = CurveClosestPoint(Point=merge_8, Curve=offset_2)  # -> Point, Parameter, Distance
vec2pt_4 = Vector2Pt(PointA=crv_cp_8.Point, PointB=crv_cp_9.Point, Unitize=False)  # -> expr("-x", Vector), Length
eval_5 = EvaluateCurve(Curve=offset_2, Parameter=crv_cp_9.Parameter)  # -> Point, Tangent, Angle
pl_5 = ConstructPlane(Origin=crv_cp_9.Point, XAxis=eval_5.Tangent, YAxis=vec2pt_4.Vector)
orient_9 = Orient(Geometry=block, Source=PlaneXY(0, 0, 0), Target=pl_5)  # -> flatten(Geometry), Transform

# ---- group: Datea / 2
lng = ListLength(List=orient_9.Geometry)
division_10 = Division(A=lng, B=2)
split_2 = SplitList(List=orient_9.Geometry, Index=division_10)  # -> ListA, ListB
data_10 = Data(split_2.ListA)

# ----
bbox_8 = BoundingBox(Content=data_10, Plane=PlaneXY(0, 0, 0))  # -> Box, Box_2
entwine_14 = Entwine(Branch00=data_10, Branch01=bbox_8.Box, FlattenInputs=True)
flip_4 = FlipMatrix(Data=entwine_14)
item_27 = ListItem(List=flip_4, Index=-1, Wrap=True)  # -> flatten(Item)
item_28 = ListItem(List=flip_4, Index="0", Wrap=True)  # -> flatten(Item)
阴角 = Geometry(orient_8.Geometry)

# ---- group: Monomer + Side/Top / Monomer Type
filter_14 = StreamFilter(Gate=list, Stream0=item_25, Stream1=item_25, Stream2=item_25)

# ----
# 槽埋-角部倾斜时
bbox_9 = BoundingBox(Content=item_25, Plane=PlaneXY(0, 0, 0))  # -> Box, Box_2
ln_9 = Line(StartPoint=pt_10, EndPoint=pt_11)
debrep = DeconstructBrep(Brep=bbox_9.Box)  # -> Faces, Edges, Vertices
deplane_6 = DeconstructPlane(Plane=ln_9)  # -> Origin, XAxis, YAxis, ZAxis
len_2 = Length(Curve=debrep.Edges)
sort_4 = SortList(Keys=len_2, ValuesA=debrep.Edges)  # -> Keys, reverse(ValuesA)
amp_2 = Amplitude(Vector=deplane_6.XAxis, Amplitude=Slider(63.5, range=10..100))
item_29 = ListItem(List=sort_4.ValuesA, Index=0, Wrap=True)  # -> Item, Item1, Item2
item_30 = ListItem(List=sort_4.ValuesA, Index=0, Wrap=True)
move_13 = Move(Geometry=deplane_6.Origin, Motion=amp_2)  # -> Geometry, Transform
len_3 = Length(Curve=item_30)
end_2 = EndPoints(Curve=item_29.Item2)  # -> Start, End
end_3 = EndPoints(Curve=item_29.Item1)  # -> Start, End
ln_10 = Line(StartPoint=deplane_6.Origin, EndPoint=move_13.Geometry)
ln_11 = Line(StartPoint=move_13.Geometry, EndPoint=deplane_6.Origin)
avr = Average(Input=[end_3.Start, end_3.End])
ln_12 = Line(StartPoint=end_2.Start, EndPoint=end_2.End)
ln_13 = Line(StartPoint=end_3.Start, EndPoint=avr)
c_script_4 = CSharpScript(iReset=Toggle(True), turns=Slider(30, range=0..100), steps=Slider(10, range=0..10))  # -> out, num; inputs numDefault: Double, iReset: Boolean, turns: Int32, steps: Double
# ---------- c_script_4: C# ----------
    if(iReset){
      number = 0;}

    for(int i = 0; i < turns;i++){
      number = number + steps;
      numStore.Add(number);
      Print(number.ToString());}

    num = numStore;
# ---------- c_script_4: C# additional code ----------
  double number = 0;
  List <double> numStore = new List<double>();
# ---------- end c_script_4 ----------
pl_6 = ConstructPlane(Origin=avr, XAxis=ln_13, YAxis=ln_12)
panel_17 = Panel(c_script_4.num)
amp_3 = Amplitude(Vector=ln_9, Amplitude=graft(c_script_4.num))

item_31 = ListItem(List=flatten(len_3), Index=0, Wrap=True)

ln_14 = Line(StartPoint=pt_10, EndPoint=pt_11)
move_14 = Move(Geometry=pt_11, Motion=ln_14)  # -> Geometry, Transform
ccx_3 = CurveCurve(CurveA=cir_2, CurveB=offset_2)  # -> Points, ParamsA, ParamsB
item_32 = ListItem(List=ccx_3.Points, Index=0, Wrap=True)  # -> flatten(Item), flatten(Item1)
ln_15 = Line(StartPoint=pt_11, EndPoint=item_32.Item)
ln_16 = Line(StartPoint=pt_11, EndPoint=move_14.Geometry)
ln_17 = Line(StartPoint=pt_11, EndPoint=item_32.Item1)
angle_3 = Angle(VectorA=ln_15, VectorB=ln_16)  # -> Angle, Reflex
angle_4 = Angle(VectorA=ln_17, VectorB=ln_16)  # -> Angle, Reflex
deg_5 = Degrees(Radians=angle_3.Angle)
deg_6 = Degrees(Radians=angle_4.Angle)
item_33 = ListItem(List=ln_16, Index=Slider(3, range=0..4), Wrap=True)
tan = Tangent(Value=degrees(deg_5))
entwine_15 = Entwine(Branch00=ln_15, Branch01=tan, FlattenInputs=True)
tan_2 = Tangent(Value=degrees(deg_6))
division_11 = Division(A=tan, B=tan_2)
panel_18 = Panel(deg_6)
panel_19 = Panel(deg_5)
addition_7 = Addition(A=division_11, B=1)
division_12 = Division(A="1", B=addition_7)
subtraction = Subtraction(A="1", B=division_12)
num = Number(division_12)
larger_4 = LargerThan(FirstNumber=tan, SecondNumber=tan_2)  # -> LargerThan, OrEqualTo

amp_4 = Amplitude(Vector=ln_11, Amplitude=expr("x/2", flatten(item_31)))
amp_5 = Amplitude(Vector=ln_10, Amplitude=expr("x/2", flatten(item_31)))
move_15 = Move(Geometry=pt_11, Motion=amp_4)  # -> Geometry, Transform
move_16 = Move(Geometry=pt_11, Motion=amp_5)  # -> Geometry, Transform
ln_18 = Line(StartPoint=move_15.Geometry, EndPoint=move_16.Geometry)

crv_22 = Curve(ln_18)
mp = Midpoint(Curve=crv_22)
eval_6 = EvaluateCurve(Curve=crv_22, Parameter=subtraction)  # -> Point, Tangent, Angle
eval_7 = EvaluateCurve(Curve=crv_22, Parameter=num)  # -> Point, Tangent, Angle
dispatch_10 = Dispatch(List=eval_6.Point, DispatchPattern=larger_4.OrEqualTo)  # -> ListA, ListB
dispatch_11 = Dispatch(List=eval_7.Point, DispatchPattern=larger_4.OrEqualTo)  # -> ListA, ListB
pt_12 = Point(dispatch_10.ListB)
pt_13 = Point(dispatch_11.ListA)
merge_10 = Merge(Data1=pt_13, Data2=pt_12)
pull_9 = PullPoint(Point=merge_10, Geometry=graft(mp), ClosestOnly=True)  # -> ClosestPoint, Distance
panel_20 = Panel(merge_10)
sort_5 = SortList(Keys=pull_9.Distance, ValuesA=merge_10)  # -> Keys, ValuesA
item_34 = ListItem(List=sort_5.ValuesA, Index=0, Wrap=True)  # -> flatten(Item)
ln_19 = Line(StartPoint=item_34, EndPoint=mp)
panel_21 = Panel(item_34)
move_17 = Move(Geometry=crv_22, Motion=ln_19)  # -> Geometry, Transform

# ---- group: 正常和阳角 - BoundingBox — 测Intersection
entwine_16 = Entwine(Branch00=flip.Curve, Branch01=offset_2, FlattenInputs=True)
flip_5 = FlipMatrix(Data=entwine_16)
item_35 = ListItem(List=flip_5, Index=0, Wrap=True)  # -> Item, Item1

# ----
move_18 = Move(Geometry=move_17.Geometry, Motion=amp_3)  # -> Geometry, Transform
ccx_4 = CurveCurve(CurveA=move_18.Geometry, CurveB=crv_12)  # -> Points, ParamsA, ParamsB
item_36 = ListItem(List=ccx_4.Points, Index=0, Wrap=True)
item_37 = ListItem(List=ccx_4.Points, Index="-1", Wrap=True)
pshift_6 = ShiftPaths(Data=item_36, Offset=-1)
pshift_7 = ShiftPaths(Data=item_37, Offset=-1)
flip_6 = FlipMatrix(Data=pshift_6)
flip_7 = FlipMatrix(Data=pshift_7)
pt_14 = Point(flip_6)
pt_15 = Point(flip_7)
pull_10 = PullPoint(Point=pt_14, Geometry=graft(mp), ClosestOnly=True)  # -> ClosestPoint, Distance
pull_11 = PullPoint(Point=pt_15, Geometry=graft(mp), ClosestOnly=True)  # -> ClosestPoint, Distance
sort_6 = SortList(Keys=pull_10.Distance, ValuesA=pt_14)  # -> Keys, ValuesA
sort_7 = SortList(Keys=pull_11.Distance, ValuesA=pt_15)  # -> Keys, ValuesA
item_38 = ListItem(List=sort_6.ValuesA, Index="-1", Wrap=True)
item_39 = ListItem(List=sort_7.ValuesA, Index="-1", Wrap=True)
ln_20 = Line(StartPoint=item_39, EndPoint=item_38)

end_4 = EndPoints(Curve=ln_20)  # -> Start, End

avr_2 = Average(Input=[end_4.Start, end_4.End])
pl_7 = ConstructPlane(Origin=avr_2, XAxis=ln_20, YAxis=graft(ln_9))
orient_10 = Orient(Geometry=graft(item_26), Source=pl_6, Target=pl_7)  # -> Geometry, Transform
orient_11 = Orient(Geometry=graft(item_25), Source=pl_6, Target=pl_7)  # -> Geometry, Transform

filter_15 = StreamFilter(Gate=list_8, Stream0=item_25, Stream1=orient_11.Geometry)

# ---- group: Monomer + Side/Top / Monomer Type (continued)
filter_16 = StreamFilter(Gate=list, Stream0=item_25, Stream1=filter_15, Stream2=item_25)

# ---- group: Monomer + Side/Top / Top/Side
filter_17 = StreamFilter(Gate=list_2, Stream0=filter_16, Stream1=filter_14)

# ----
filter_18 = StreamFilter(Gate=list_8, Stream0=item_26, Stream1=orient_10.Geometry)

# ---- group: 阳角分类
filter_19 = StreamFilter(Gate=list, Stream0=item_26, Stream1=filter_18, Stream2=item_26)
filter_20 = StreamFilter(Gate=list, Stream0=item_26, Stream1=item_26, Stream2=item_26)
filter_21 = StreamFilter(Gate=list_2, Stream0=filter_19, Stream1=filter_20)

# ----
阳角 = Geometry(filter_21)

# ---- group: 正常和阳角 - BoundingBox — 测Intersection (continued)
c_script_5 = CSharpScript(BrepMain=item_27, BrepStay=filter_17)  # -> out, BrepInters, BrepRemain, IndexM, IndexS; inputs BrepMain: list of Brep, BrepStay: list of Brep
# ---------- c_script_5: C# ----------
    List<Brep> BrepI = new List<Brep>();
    List<Brep> BrepR = new List<Brep>();
    List<int> num = new List<int>();
    List<int> numS = new List<int>();


    double tolr = Rhino.RhinoDoc.ActiveDoc.ModelAbsoluteTolerance;

    for(int j = 0; j < BrepMain.Count;j++){
      for(int i = 0; i < BrepStay.Count;i++){
        bool test = Rhino.Geometry.Intersect.Intersection.BrepBrep(BrepMain[j], BrepStay[i], tolr, out crv, out pts);
        if(test && crv.Length != 0){
          tryThis = true;
          numS.Add(i);
          break;}
        else{
          tryThis = false;}
      }
      if(tryThis){
        BrepI.Add(BrepMain[j]);
        num.Add(j);
      }
      else{
        BrepR.Add(BrepMain[j]);
      }
    }



    BrepInters = BrepI;
    BrepRemain = BrepR;
    IndexM = num;
    IndexS = numS;
# ---------- c_script_5: C# additional code ----------
  Rhino.Geometry.Curve[] crv;
  Rhino.Geometry.Point3d[] pts;
  bool tryThis;
# ---------- end c_script_5 ----------
item_40 = ListItem(List=item_27, Index=c_script_5.IndexM, Wrap=True)  # -> graft(Item)
item_41 = ListItem(List=filter_17, Index=c_script_5.IndexS, Wrap=True)  # -> graft(Item)
cull_i_8 = CullIndex(List=item_28, Indices=c_script_5.IndexM, Wrap=True)
item_42 = ListItem(List=item_28, Index=c_script_5.IndexM, Wrap=True)  # -> graft(Item)
area_6 = Area(Geometry=item_40)  # -> Area, Centroid
bbx = BrepBrep(BrepA=item_40, BrepB=item_41)  # -> simplify(Curves), Points
area_7 = Area(Geometry=bbx.Curves)  # -> Area, Centroid
ln_21 = Line(StartPoint=area_6.Centroid, EndPoint=area_7.Centroid)
mp_2 = Midpoint(Curve=ln_21)
scale = Scale(Geometry=ln_21, Center=mp_2, Factor=Slider(1000000, range=0..1000000))  # -> Geometry, Transform
ccx_5 = CurveCurve(CurveA=scale.Geometry, CurveB=bbx.Curves)  # -> Points, ParamsA, ParamsB
item_43 = ListItem(List=ccx_5.Points, Index=0, Wrap=True)  # -> Item, Item1
ln_22 = Line(StartPoint=item_43.Item1, EndPoint=item_43.Item)
move_19 = Move(Geometry=item_42, Motion=ln_22)  # -> simplify(Geometry), Transform
bbox_10 = BoundingBox(Content=move_19.Geometry, Plane=PlaneXY(0, 0, 0))  # -> Box, Box_2

# ----
# 这里如果跑红也不要紧，
# 说明单体没有出现相撞的情况
area_8 = Area(Geometry=bbox_10.Box)  # -> Area, Centroid

# ---- group: 正常和阳角 - BoundingBox — 测Intersection (continued)
entwine_17 = Entwine(Branch00=move_19.Geometry, Branch01=area_8.Centroid, FlattenInputs=True)
flip_8 = FlipMatrix(Data=entwine_17)
item_44 = ListItem(List=flip_8, Index="0", Wrap=True)  # -> flatten(Item)
item_45 = ListItem(List=flip_8, Index="-1", Wrap=True)  # -> flatten(Item)
pull_12 = PullPoint(Point=item_45, Geometry=item_35.Item, ClosestOnly=True)  # -> flatten(ClosestPoint), Distance
pull_13 = PullPoint(Point=item_45, Geometry=item_35.Item1, ClosestOnly=True)  # -> flatten(ClosestPoint), Distance
vec2pt_5 = Vector2Pt(PointA=item_45, PointB=pull_12.ClosestPoint, Unitize=False)  # -> Vector, Length
vec2pt_6 = Vector2Pt(PointA=item_45, PointB=pull_13.ClosestPoint, Unitize=False)  # -> Vector, Length
multiplication_13 = Multiplication(A=vec2pt_5.Vector, B=vec2pt_6.Vector)
larger_5 = LargerThan(FirstNumber=multiplication_13, SecondNumber=0)  # -> LargerThan, OrEqualTo
dispatch_12 = Dispatch(List=item_44, DispatchPattern=larger_5.LargerThan)  # -> ListA, ListB

# ---- group: Normal
geo_2 = Geometry(cull_i_8)

# ---- group: Normal-Move
移动 = Geometry(dispatch_12.ListA)

# ----
# PLAN Results
merge_11 = Merge(Data1=geo_2, Data2=阳角, Data3=移动, Data4=阴角)

# ==== cluster Cluster
G = ClusterInput()
rotate = Rotate(Geometry=G, Angle=3.141592654, Plane=PlaneXY(0, 0, 0))  # -> Geometry, Transform
boxprop = BoxProperties(Box=rotate.Geometry)  # -> Center, Diagonal, Area, Volume, Degeneracy
bbox = BoundingBox(Content=rotate.Geometry, Plane=PlaneXY(0, 0, 0))  # -> Box, Box_2
debox = DeconstructBox(Box=bbox.Box)  # -> Plane, X, Y, Z
pdecon = Deconstruct(Point=boxprop.Center)  # -> XComponent, YComponent, ZComponent
dedomain = DeconstructDomain(Domain=debox.Y)  # -> Start, End
pt = ConstructPoint(XCoordinate=pdecon.XComponent, YCoordinate=dedomain.Start, ZCoordinate=pdecon.ZComponent)
xy = XYPlane(Origin=Point(0, 0, 0))
pl_origin = PlaneOrigin(Base=xy, Origin=pt)
orient = Orient(Geometry=rotate.Geometry, Source=pl_origin, Target=xy)  # -> Geometry, Transform
G_2 = ClusterOutput(orient.Geometry)
